# Grasshopper definition dome_multi.gh (Grasshopper 1.0.8)

number_slider = Slider(5, range=0..10)
polygon = Polygon(Plane=PlaneXY(0, 0, 0), Radius=Slider(2.5, range=0..5), Segments=number_slider, FilletRadius=0)  # -> Polygon, Length
offset = OffsetCurve(Curve=polygon.Polygon, Thinkness=Slider(-0.2, range=-1..1), Corners=1)
Z = UnitZ(Factor=Slider(4.65, range=1..8))
Z_2 = UnitZ(Factor=Slider(2, range=0..8))
explode = Explode(Curve=offset, Recursive=True)  # -> Segments, Vertices
number_slider_2 = Slider(2.3, range=0..8)
move = Move(Geometry=explode.Vertices, Motion=Z_2)  # -> Geometry, Transform
area = Area(Geometry=polygon.Polygon)  # -> Area, Centroid
ln = Line(StartPoint=explode.Vertices, EndPoint=move.Geometry)
move_2 = Move(Geometry=offset, Motion=Z_2)  # -> Geometry, Transform
move_3 = Move(Geometry=area.Centroid, Motion=Z)  # -> Geometry, Transform

pcen = PolygonCenter(Polyline=move_2.Geometry)  # -> CenterV, CenterE, CenterA
Z_3 = UnitZ(Factor=1)
vec2pt = Vector2Pt(PointA=move.Geometry, PointB=pcen.CenterV, Unitize=False)  # -> Vector, Length
pl = ConstructPlane(Origin=pcen.CenterV, XAxis=Z_3, YAxis=vec2pt.Vector)
rad = Radians(Degrees="-90")
arc = ArcSED(Start=move.Geometry, End=move_3.Geometry, Direction=pl)  # -> Arc, Plane, Radius
division = Division(A="360", B=number_slider)
rotate = Rotate(Geometry=arc.Arc, Angle=degrees(division), Plane=PlaneXY(0, 0, 0))  # -> Geometry, Transform
division_2 = Division(A="360", B=number_slider)
rotate_2 = Rotate(Geometry=rotate.Geometry, Angle=degrees(division_2), Plane=PlaneXY(0, 0, 0))  # -> Geometry, Transform
rulesrf = RuledSurface(CurveA=arc.Arc, CurveB=rotate_2.Geometry)

Z_4 = UnitZ(Factor=number_slider_2)

rdiff = RegionDifference(CurvesA=polygon.Polygon, CurvesB=offset)
number_slider_3 = Slider(0.81, range=-0.1..0.9)
explode_2 = Explode(Curve=polygon.Polygon, Recursive=True)  # -> graft(Segments), Vertices
boundary = BoundarySurfaces(Edges=rdiff)
midpt = CurveMiddle(Curve=explode_2.Segments)
len = Length(Curve=explode_2.Segments)
multiplication = Multiplication(A=len, B=Slider(0.35, range=0..0.5))
multiplication_2 = Multiplication(A=number_slider_2, B=Slider(0.86, range=0..1))
Z_5 = UnitZ(Factor=1)
neg = Negative(Value=multiplication_2)
neg_2 = Negative(Value=multiplication)
scale_nu = ScaleNU(Geometry=boundary, Plane=PlaneXY(0, 0, 0), ScaleX=number_slider_3, ScaleY=number_slider_3, ScaleZ=1)  # -> Geometry, Transform
vec2pt_2 = Vector2Pt(PointA=midpt, PointB=area.Centroid, Unitize=False)  # -> Vector, Length
pl_2 = ConstructPlane(Origin=midpt, XAxis=explode_2.Segments, YAxis=Z_5)
dom = ConstructDomain(DomainStart=multiplication, DomainEnd=neg_2)
dom_2 = ConstructDomain(DomainStart=multiplication_2, DomainEnd=neg)
rectangle = Rectangle(Plane=pl_2, XSize=dom, YSize=dom_2, Radius=0)  # -> Rectangle, Length
line = LineSDL(Start=midpt, Direction=vec2pt_2.Vector, Length=Slider(1.2, range=0..2))
extr = Extrude(Base=rectangle.Rectangle, Direction=line)  # -> flatten(Extrusion)
extr_2 = Extrude(Base=scale_nu.Geometry, Direction=Z_4)
sdiff = SolidDifference(BrepsA=extr_2, BrepsB=extr)

ln_2 = Line(StartPoint=move.Geometry, EndPoint=move_3.Geometry)
division_3 = Division(A="360", B=number_slider)
rotate_3 = Rotate(Geometry=ln_2, Angle=degrees(division_3), Plane=PlaneXY(0, 0, 0))  # -> Geometry, Transform
rotate_4 = Rotate(Geometry=rotate_3.Geometry, Angle=degrees(Slider(201, range=0..360)), Plane=PlaneXY(0, 0, 0))  # -> Geometry, Transform
rulesrf_2 = RuledSurface(CurveA=ln_2, CurveB=rotate_4.Geometry)

arc_2 = ArcSED(Start=move.Geometry, End=move_3.Geometry, Direction=Z)  # -> Arc, Plane, Radius
division_4 = Division(A="360", B=number_slider)
rotate_5 = Rotate(Geometry=arc_2.Arc, Angle=degrees(division_4), Plane=PlaneXY(0, 0, 0))  # -> Geometry, Transform
rotate_6 = Rotate(Geometry=rotate_5.Geometry, Angle=degrees(Slider(185, range=0..360)), Plane=PlaneXY(0, 0, 0))  # -> Geometry, Transform
rulesrf_3 = RuledSurface(CurveA=arc_2.Arc, CurveB=rotate_6.Geometry)

preview = CustomPreview(Geometry=sdiff, Material=ColourSwatch(SwatchColor=RGB(69, 69, 69)))

mesh = MeshBrep(
    Brep=rulesrf_3,
    Settings={GridMaxCount=0, GridMinCount=16, JaggedSeams=False, MaxEdgeLength=0, MinEdgeLength=0.0001, MinTolerance=0, Refine=True, RefineAngle=0, RelativeTolerance=0.65, SimplePlanes=True, Tolerance=0})
medges = MeshEdges(Mesh=mesh)  # -> NakedEdges, InteriorEdges, NonManifoldEdges
mp = MultiPipe(
    Curves=medges.InteriorEdges,
    NodeSize=Slider(0.03, range=0.001..0.5),
    EndOffset=1,
    StrutSize=1,
    Segment=0,
    KinkAngle=0.6,
    CubeFit=0,
    Caps=0)
meshsubd = MeshFromSubD(SubD=mp, Density="0")
unweld = UnweldMesh(Mesh=meshsubd, Angle=0)

preview_2 = CustomPreview(Geometry=unweld, Material=ColourSwatch(SwatchColor=RGB(92, 92, 92)))
