# Grasshopper definition dome_simple.gh (Grasshopper 1.0.8)

number_slider = Slider(7, range=0..10)
polygon = Polygon(Plane=PlaneXY(0, 0, 0), Radius=Slider(10, range=0..15), Segments=number_slider, FilletRadius=0)  # -> Polygon, Length

explode = Explode(Curve=polygon.Polygon, Recursive=True)  # -> graft(Segments), Vertices
number_slider_2 = Slider(4.7, range=0..5)
eval = EvaluateCurve(Curve=reparameterize(explode.Segments), Parameter=".5")  # -> Point, Tangent, Angle
Z = UnitZ(Factor=1)
len = Length(Curve=explode.Segments)
pl = ConstructPlane(Origin=eval.Point, XAxis=explode.Segments, YAxis=Z)
division = Division(A=len, B="2")
arc = Arc(Plane=pl, Radius=division, Angle=Domain(0, 3.141592654))  # -> Arc, Length
pln = Plane(pl)
neg = Negative(Value=number_slider_2)
merge = Merge(Data1=arc.Arc, Data2=explode.Segments)
line = LineSDL(Start=pln, Direction=pln, Length=number_slider_2)
line_2 = LineSDL(Start=pln, Direction=pln, Length=neg)
merge_2 = Merge(Data1=line, Data2=line_2)
boundary = BoundarySurfaces(Edges=merge)
extr = Extrude(Base=boundary, Direction=merge_2)  # -> flatten(Extrusion)

offset = OffsetCurve(Curve=polygon.Polygon, Thinkness=Slider(1, range=0..2), Corners=1)
explode_2 = Explode(Curve=offset, Recursive=True)  # -> Segments, Vertices
division_2 = Division(A="360", B=number_slider)
merge_3 = Merge(Data1=explode.Vertices, Data2=explode_2.Vertices)
area = Area(Geometry=polygon.Polygon)  # -> Area, Centroid
duppt = RemoveDuplicatePts(Points=merge_3, Tolerance=0.01)
pl_2 = ConstructPlane(Origin=area.Centroid, XAxis=duppt, YAxis=Z)
rad = Radians(Degrees="90")
arc_2 = Arc(Plane=pl_2, Radius=duppt, Angle=rad)  # -> Arc, Length
rotate = Rotate(Geometry=arc_2.Arc, Angle=degrees(division_2), Plane=PlaneXY(0, 0, 0))  # -> Geometry, Transform
rulesrf = RuledSurface(CurveA=arc_2.Arc, CurveB=rotate.Geometry)
join = BrepJoin(Breps=flatten(rulesrf))  # -> Breps, Closed
cap = CapHoles(Brep=join.Breps)
dispatch = Dispatch(List=cap, DispatchPattern=[True, False])  # -> ListA, ListB
sdiff = SolidDifference(BrepsA=dispatch.ListB, BrepsB=dispatch.ListA)

sdiff_2 = SolidDifference(BrepsA=sdiff, BrepsB=extr)
outer_srf = ListItem(List=join.Breps, Index="1", Wrap=True)
inner_srf = ListItem(List=join.Breps, Index="0", Wrap=True)
